# Grasshopper definition FloorPlanGenerator_Combined.gh (Grasshopper 1.0.7)
# plug-ins: Wombat

path = FilePath("C:\Users\REN\Downloads\dataObject.json")  # disabled
data = Data("C:\Users\REN\Downloads\dataObject.json")
file = ReadFile(File=data, PerLineParse=True)
_7000 = Data(Tree({0}: [16.77192857, 4.946428571, 2.930428571, 8.329285714], {1}: [24.49778571, 2.757857143, 3.071285714, 6.752142857], {2}: [21.2115, 1.683571429, 2.799571429, 9.357857143], {3}: [11.58021429, 8.429285714, 3.707285714, 7.795], {4}: [22.57307143, 2.766428571, 2.816428571, 3.789285714], {5}: [16.5945, 0.02642857143, 3.068714286, 8.442142857]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))
integer = Integer(_7000)
python = GhPythonScript(x=data)  # -> out, lineType, vertices, corridor, levels
# ---------- python: Python ----------
__author__ = "REN"
__version__ = "2023.08.24"

import rhinoscriptsyntax as rs
import json

with open(x, 'r') as file:
    data = json.load(file)
print(data)

#print(data["geometry"]["type"])
#print(data["geometry"]["coordinates"])
#print(data["properties"]["corridorType"])
#print(data["properties"]["floorsInput"])

lineType = data["geometry"]["type"]
vertices = data["geometry"]["coordinates"]
corridor = data["properties"]["corridorType"]
levels = data["properties"]["floorsInput"]
# ---------- end python ----------
panel = Panel(python.lineType)
branch = TreeBranch(Tree=integer, Path=Slider(674, range=0..1000), MaintainPaths=True)
c_script = CSharpScript(x=python.vertices)  # -> out, A
# ---------- c_script: C# ----------
    A = x;
# ---------- end c_script ----------
panel_2 = Panel(branch)
explode_tree = ExplodeTree(Data=graft(branch))  # -> Branch0, Branch1, Branch2, Branch3
panel_3 = Panel(file)
# 31.8
number_slider = Slider(31.8, range=25..50)
find_assemblies = GhPythonScript()  # -> out
# ---------- find_assemblies: Python ----------
import Grasshopper as gh

this = ghenv.Component
thisDoc = this.OnPingDocument()

asms = []

for obj in thisDoc.Objects:
    #print obj.GetType().BaseType
    
    #if obj.Obsolete: print 'Warning: Obsolete'
    #print 'Name: {}\nDescription: {}\nCategory: {} -> {}\n '.format(obj.Name, obj.Description, obj.Category, obj.SubCategory)
    #print 'Pivot: {} \t Bounds: {}'.format(obj.Attributes.Pivot, obj.Attributes.Bounds)
    
    asm = gh.Instances.ComponentServer.FindAssemblyByObject(obj.ComponentGuid)
    
    #print(x.IsCoreLibrary)
    if asm is not None and not asm.IsCoreLibrary:
        asms.append(asm.Name)
    
print asms
# ---------- end find_assemblies ----------

# ----
# Create Large Rectangle and Populate it with loads of points
number_slider_2 = Slider(54.9, range=0..100)
number_slider_3 = Slider(82.3, range=0..100)
neg = Negative(Value=number_slider_2)
neg_2 = Negative(Value=number_slider_3)
concat = Concatenate(FragmentA=neg, FragmentB=number_slider_2, JoinSeparator=" to ")
concat_2 = Concatenate(FragmentA=neg_2, FragmentB=number_slider_3, JoinSeparator=" to ")
rectangle = Rectangle(Plane=PlaneXY(0, 0, 0), XSize=concat, YSize=concat_2, Radius=0)  # -> Rectangle, Length
pop2d = Populate2D(Region=rectangle.Rectangle, Count=explode_tree.Branch1, Seed=explode_tree.Branch0)

panel_4 = Panel(find_assemblies)

# ---- group: Animate to generate dataset
number_slider_4 = Slider(3, range=0..1295)
toggle = BooleanToggle(False)

# ----
levels = GetInteger(python.levels, AtLeast=1, AtMost=1, Maximum=2147483647, Minimum=-2147483648, TreeAccess=False)
data_2 = Data(c_script.A)
subtraction = Subtraction(A=explode_tree.Branch1, B=explode_tree.Branch2)
vertices = GetNumber(data_2, AtLeast=1, AtMost=1, Maximum=1.797693135e+308, Minimum=-1.797693135e+308, TreeAccess=False)
int = Integer(levels)

# ----
# Random Reduce and Create Polyline
reduce = RandomReduce(List=pop2d, Reduction=subtraction, Seed=1)
pdecon = Deconstruct(Point=reduce)  # -> XComponent, YComponent, ZComponent
sort = SortList(Keys=pdecon.XComponent, ValuesA=reduce)  # -> Keys, ValuesA
pline = PolyLine(Vertices=sort.ValuesA, Closed=False)

panel_5 = Panel(data_2)
flip = FlipMatrix(Data=vertices)
subtraction_2 = Subtraction(A=int, B="1")
panel_6 = Panel(flip)
bang = ExplodeTree(Data=flip)  # -> Branch0, Branch1
pt = ConstructPoint(XCoordinate=bang.Branch0, YCoordinate=bang.Branch1, ZCoordinate=0)
linetype = GetString(python.lineType, AtLeast=1, AtMost=1, TreeAccess=False)
round = Round(Number=number_slider)  # -> Nearest, Floor, Ceiling

# ----
# Explode Polyline and measure angle,
# if greater than 100° don't send it, if less
# pass it thru
explode = Explode(Curve=pline, Recursive=True)  # -> Segments, Vertices
bang_2 = ExplodeTree(Data=simplify(graft(explode.Segments)))  # -> Branch0, Branch1
angle = Angle(VectorA=bang_2.Branch0, VectorB=bang_2.Branch1)  # -> Angle, Reflex
deg = Degrees(Radians=angle.Angle)
smaller = SmallerThan(FirstNumber=deg, SecondNumber="100")  # -> SmallerThan, OrEqualTo
filter = StreamFilter(Gate=smaller.SmallerThan, Stream1=pline)  # disabled

points = PointList(Points=pt, Size=Slider(53, range=0..100))
txt = Text(linetype)

# ----
# Half of Building Width (m)
number_slider_5 = Slider(12.5, range=0..100)
neg_3 = Negative(Value=number_slider_5)
merge = Merge(Data1=number_slider_5, Data2=neg_3)

# ----
# Half of Corridor Width (m)
number_slider_6 = Slider(1, range=0..100)
neg_4 = Negative(Value=number_slider_6)
merge_2 = Merge(Data1=number_slider_6, Data2=neg_4)

# ----
# Half of Building Width (m)
number_slider_7 = Slider(12.5, range=0..100)
neg_5 = Negative(Value=number_slider_7)
merge_3 = Merge(Data1=neg_4, Data2=neg_5)

# ----
# Single or Double Loaded Parameter
list = ValueList({"Double Loaded": 0, "Single Loaded": 1}, selected="Double Loaded")
corridor = GetString(python.corridor, AtLeast=1, AtMost=1, TreeAccess=False)

division = Division(A=round.Nearest, B="2")

# ----
# Polygon or LineString
# Sets Closed or Open Polyline (Pull Geometry Type from JSON)
panel_7 = Panel("""Polygon
LineString""")
list_2 = ValueList({"Polygon": 0, "LineString": 1}, selected="LineString")
bang_3 = ExplodeTree(Data=graft(panel_7))  # -> Branch0, Branch1
filter_2 = StreamFilter(Gate=list_2, Stream0=bang_3.Branch0, Stream1=bang_3.Branch1)
tmatch = MatchText(Text=txt, RegEx="Polygon", Case=True)
filter_3 = StreamFilter(Gate=tmatch, Stream0=Toggle(False), Stream1=Toggle(True))
filter_4 = StreamFilter(Gate=tmatch, Stream0=Slider(5, range=0..10), Stream1=division)
pline_2 = PolyLine(Vertices=flatten(pt), Closed=filter_3)

tmatch_2 = MatchText(Text=corridor, RegEx="single loaded", Case=True)
int_2 = Integer(tmatch_2)
filter_5 = StreamFilter(Gate=int_2, Stream0=merge, Stream1=merge_3)

# ----
# Create Corridor Boundary
offset = OffsetCurve(Curve=pline_2, Distance=merge_2, Corners=1)  # -> simplify(Curve)
end = EndPoints(Curve=offset)  # -> Start, End
bang_4 = ExplodeTree(Data=offset)  # -> Branch0, Branch1
bang_5 = ExplodeTree(Data=end.Start)  # -> Branch0, Branch1
bang_6 = ExplodeTree(Data=end.End)  # -> Branch0, Branch1
ln = Line(StartPoint=bang_5.Branch0, EndPoint=bang_5.Branch1)
ln_2 = Line(StartPoint=bang_6.Branch0, EndPoint=bang_6.Branch1)
merge_4 = Merge(Data1=bang_4.Branch0, Data2=ln, Data3=bang_4.Branch1, Data4=ln_2)  # -> flatten(Result)

# ----
# Create Building Boundary
offset_2 = OffsetCurve(Curve=pline_2, Distance=filter_5, Corners=1)  # -> simplify(Curve)
end_2 = EndPoints(Curve=offset_2)  # -> Start, End
bang_7 = ExplodeTree(Data=offset_2)  # -> Branch0, Branch1
bang_8 = ExplodeTree(Data=end_2.Start)  # -> Branch0, Branch1
bang_9 = ExplodeTree(Data=end_2.End)  # -> Branch0, Branch1
ln_3 = Line(StartPoint=bang_8.Branch0, EndPoint=bang_8.Branch1)
ln_4 = Line(StartPoint=bang_9.Branch0, EndPoint=bang_9.Branch1)
merge_5 = Merge(Data1=bang_7.Branch0, Data2=ln_3, Data3=bang_7.Branch1, Data4=ln_4)  # -> flatten(Result)
join = JoinCurves(Curves=merge_5, Preserve=False)

# ----
# Create Corridor Boundary
offset_3 = OffsetCurve(Curve=pline_2, Distance=merge_2, Corners=1)  # -> simplify(Curve)
filter_6 = StreamFilter(Gate=tmatch, Stream0=merge_4, Stream1=offset_3)
join_2 = JoinCurves(Curves=filter_6, Preserve=False)

# ---- group: Corridor Curves
crv = Curve(flatten(offset_3))

# ---- group: Corridor Centerline
crv_2 = Curve(pline_2)

# ----
len = Length(Curve=crv_2)
division_2 = Division(A=len, B="120")
round_2 = Round(Number=division_2)  # -> Nearest, Floor, Ceiling
divide = DivideCurve(Curve=crv_2, Count=round_2.Ceiling, Kinks=False)  # -> Points, Tangents, Parameters

number_slider_8 = Slider(4, range=0..10)
series = Series(Start=number_slider_8, Step=number_slider_8, Count=subtraction_2)  # -> flatten(Series)
unit_z = UnitZ(Factor=series)  # -> simplify(graft(UnitVector))
negative = Negative(Value=number_slider_8)

# ----
# Setting File Path for CSV Output (Not required, yet saving for some reason)
int_3 = Integer(number_slider_4)
path_2 = FilePath("C:\Users\REN\Documents\MaCAD\AIArch\GraphML\ClassProject\Datasets\T01-Linear\newCSVs\")
format = Format(Format="{0:0000}", Culture=127, Data0=int_3)
concat_3 = Concatenate(FragmentA=path_2, FragmentB="T01Nodes", FragmentC=format, FragmentD=".csv")
concat_4 = Concatenate(FragmentA=path_2, FragmentB="T01Edges", FragmentC=format, FragmentD=".csv")
panel_8 = Panel(concat_4)

path_3 = FilePath("C:\Users\REN\Documents\MaCAD\Thesis\JSON-Output.json")

# ----
# Create Building Boundary
offset_4 = OffsetCurve(Curve=pline_2, Distance=filter_5, Corners=1)  # -> simplify(Curve)

filter_7 = StreamFilter(Gate=tmatch, Stream0=merge_5, Stream1=offset_4)

join_3 = JoinCurves(Curves=filter_7, Preserve=False)

# ---- group: Boundary
crv_3 = Curve(join_3)

# ----
# Corridor and Building Boundaries
crv_4 = Curve(pline_2)
explode_2 = Explode(Curve=crv_4, Recursive=True)  # -> Segments, Vertices
boundary_surfaces = BoundarySurfaces(Edges=flatten(crv_3))

# ----
# Divide Curve, Drop First and Last
number_slider_9 = Slider(5, range=0..10)
divdist = DivideDistance(Curve=crv_4, Distance=number_slider_9)  # -> Points, Tangents, Parameters
cull_i = CullIndex(List=divdist.Points, Indices="0", Wrap=True)

# ----
# Loft Corridor Curves and
# Trim / Split Demising Curves
# Random Reduce Demsing to
# Make Larger Rooms
Z = UnitZ(Factor=1)
move = Move(Geometry=join_2, Motion=Z)  # -> Geometry, Transform
loft = Loft(
    Curves=[join_2, move.Geometry],
    Options={Adjust=False, Closed=False, LoftEnds=0, LoftSimp=0, LoftType=0, Rebuild=10, Refit=0.01})
pull = PullPoint(Point=cull_i, Geometry=offset_4, ClosestOnly=True)  # -> ClosestPoint, Distance
ln_5 = Line(StartPoint=cull_i, EndPoint=pull.ClosestPoint)
split = SplitWithBrep(Curve=simplify(ln_5), Brep=loft)  # -> Curve, Points
item = ListItem(List=split.Curve, Index=Slider(1, range=0..1), Wrap=True)
reduce_2 = RandomReduce(List=flatten(item), Reduction=filter_4, Seed=1)

# ----
# Clean Up Corners
end_3 = EndPoints(Curve=reduce_2)  # -> Start, End
cullpt = CullDuplicates(Points=end_3.End, Tolerance=0.1, CullMode=3)  # -> Points, Indices, Valence
item_2 = ListItem(List=reduce_2, Index=cullpt.Indices, Wrap=True)

# ---- group: Demising
crv_5 = Curve(item_2)

# ----
# Sort out Corridor
merge_6 = Merge(Data1=crv_5, Data2=crv)  # -> flatten(Result)
srf = Surface(boundary_surfaces)
midpt = CurveMiddle(Curve=pline_2)
srfsplit = SurfaceSplit(Surface=srf, Curves=merge_6)
srf_cp = SurfaceClosestPoint(Point=midpt, Surface=srfsplit)  # -> Point, UVPoint, Distance
smaller_2 = SmallerThan(FirstNumber=srf_cp.Distance, SecondNumber="1e-5")  # -> SmallerThan, OrEqualTo
dispatch = Dispatch(List=srfsplit, DispatchPattern=smaller_2.SmallerThan)  # -> ListA, ListB

# ----
# Sort Surfaces Along Corridor Center Curve
area = Area(Geometry=dispatch.ListB)  # -> Area, Centroid
pull_2 = PullPoint(Point=area.Centroid, Geometry=pline_2, ClosestOnly=True)  # -> ClosestPoint, Distance

# ---- group: Cooridor Nodes
alongcrv = SortAlongCurve(Points=pull_2.ClosestPoint, Curve=pline_2)  # -> Points, Indices

# ----
mindex = MemberIndex(Set=pull_2.ClosestPoint, Member=alongcrv.Points)  # -> Index, Count
cset = CreateSet(List=flatten(mindex.Index))  # -> Set, Map
item_3 = ListItem(List=dispatch.ListB, Index=cset.Set, Wrap=True)

# ---- group: Corridor edges
explode_3 = Explode(Curve=crv_2, Recursive=True)  # -> Segments, Vertices
cull_duplicates = CullDuplicates(Points=alongcrv.Points, Tolerance=0.1, CullMode=3)  # -> Points, Indices, Valence
point = Point([explode_3.Vertices, cull_duplicates.Points])
curve_closest_point = CurveClosestPoint(Point=flatten(point), Curve=crv_2)  # -> Point, Parameter, Distance
shatter = Shatter(Curve=crv_2, Parameters=curve_closest_point.Parameter)
end_points = EndPoints(Curve=shatter)  # -> Start, End
point_2 = Point([end_points.Start, end_points.End])
cull_duplicates_2 = CullDuplicates(Points=alongcrv.Points, Tolerance=0.1, CullMode=3)  # -> flatten(Points), Indices, Valence
cull_duplicates_3 = CullDuplicates(Points=point_2, Tolerance=0.1, CullMode=3)  # -> Points, Indices, Valence

# ----
filter_8 = StreamFilter(Gate=int_2, Stream0=cull_duplicates_2.Points, Stream1=cull_duplicates_3.Points)
data_3 = Data(flatten(filter_8))

# ---- group: Corridor edges
# Corridor Edges
shift_list = ShiftList(List=data_3, Shift=1, Wrap=True)
cull_index = CullIndex(List=shift_list, Indices="-1", Wrap=True)
dispatch_2 = Dispatch(List=cull_index, DispatchPattern=[True, False])  # -> ListA, ListB
dispatch_3 = Dispatch(List=data_3, DispatchPattern=[True, False])  # -> ListA, ListB
point_3 = Point(dispatch_3.ListA)
point_4 = Point(dispatch_3.ListB)
point_5 = Point(dispatch_2.ListA)
point_6 = Point(dispatch_2.ListB)
line = Line(StartPoint=point_3, EndPoint=point_4)
line_2 = Line(StartPoint=point_5, EndPoint=point_6)
weave = Weave(Pattern=[0, 1], Stream0=line, Stream1=line_2, NullGaps=False)

# ----
# Find Room Closest to Egress Points
geo = Geometry(item_3)
area_2 = Area(Geometry=geo)  # -> Area, Centroid
dist = Distance(PointA=area_2.Centroid, PointB=graft(divide.Points))
sort_2 = SortList(Keys=dist, ValuesA=geo)  # -> Keys, ValuesA
cull_i_2 = CullIndex(List=sort_2.ValuesA, Indices="0", Wrap=True)  # -> flatten(List)

# ---- group: Egress
item_4 = ListItem(List=sort_2.ValuesA, Index=0, Wrap=True)  # -> flatten(Item)

# ----
area_3 = Area(Geometry=cull_i_2)  # -> Area, Centroid

# ---- group: Egress Nodes
area_4 = Area(Geometry=item_4)  # -> Area, Centroid

# ----
cset_2 = CreateSet(List=area_3.Centroid)  # -> Set, Map
mindex_2 = MemberIndex(Set=cset_2.Set, Member=area_4.Centroid)  # -> Index, Count
cull_i_3 = CullIndex(List=cset_2.Set, Indices=flatten(mindex_2.Index), Wrap=True)

cp = ClosestPoint(Point=cull_i_3, Cloud=alongcrv.Points)  # -> ClosestPoint, CPIndex, Distance

# ---- group: Rooms Egdes
line_3 = Line(StartPoint=cull_i_3, EndPoint=cp.ClosestPoint)

# ----
data_4 = Data(flatten(line_3))

cp_2 = ClosestPoint(Point=area_4.Centroid, Cloud=flatten(data_3))  # -> ClosestPoint, CPIndex, Distance
pt_2 = Point(area_4.Centroid)
pt_3 = Point(cp_2.ClosestPoint)
line_4 = Line(StartPoint=area_4.Centroid, EndPoint=cp_2.ClosestPoint)
point_list = PointList(Points=pt_3)
move_2 = Move(Geometry=flatten(pt_2), Motion=unit_z)  # -> Geometry, Transform
move_3 = Move(Geometry=flatten(line_4), Motion=unit_z)  # -> Geometry, Transform
merge_7 = Merge(Data1=flatten(pt_2), Data2=flatten(move_2.Geometry))
lng = ListLength(List=pt_2)
merge_8 = Merge(Data1=flatten(line_4), Data2=flatten(move_3.Geometry))
lng_2 = ListLength(List=line_4)

# ---- group: Egress nodes
move_4 = Move(Geometry=flatten(item_4), Motion=unit_z)  # -> Geometry, Transform
data_5 = Data([item_4, move_4.Geometry])
area_5 = Area(Geometry=move_4.Geometry)  # -> Area, Centroid
area_6 = Area(Geometry=data_5)  # -> Area, Centroid

# ---- group: Corridor nodes
move_5 = Move(Geometry=flatten(data_3), Motion=unit_z)  # -> Geometry, Transform

# ---- group: Room Edges
move_6 = Move(Geometry=flatten(data_4), Motion=unit_z)  # -> Geometry, Transform

# ---- group: Room Nodes
move_7 = Move(Geometry=flatten(cull_i_3), Motion=unit_z)  # -> Geometry, Transform

# ---- group: Cooridor Edges
move_8 = Move(Geometry=flatten(weave), Motion=unit_z)  # -> Geometry, Transform

# ---- group: Egress Nodes Per Level
partition = PartitionList(List=merge_7, Size=lng)  # -> simplify(Chunks)

# ---- group: Egress Edges Per Level
partition_2 = PartitionList(List=merge_8, Size=lng_2)  # -> simplify(Chunks)

# ----
data_6 = Data(flatten(weave))

merge_9 = Merge(Data1=data_3, Data2=flatten(move_5.Geometry))
merge_10 = Merge(Data1=data_4, Data2=flatten(move_6.Geometry))
merge_11 = Merge(Data1=cull_i_3, Data2=flatten(move_7.Geometry))
merge_12 = Merge(Data1=flatten(weave), Data2=flatten(move_8.Geometry))
lng_3 = ListLength(List=data_3)
lng_4 = ListLength(List=data_4)
lng_5 = ListLength(List=cull_i_3)
lng_6 = ListLength(List=weave)

# ---- group: Corridor Edges Per Level
partition_3 = PartitionList(List=merge_12, Size=lng_6)  # -> simplify(Chunks)

# ---- group: Corridor Nodes Per Level
partition_4 = PartitionList(List=merge_9, Size=lng_3)

# ---- group: Room Edges Per Level
partition_5 = PartitionList(List=merge_10, Size=lng_4)

# ---- group: Room Nodes Per Level
partition_6 = PartitionList(List=merge_11, Size=lng_5)

# ----
data_7 = Data([data_4, move_6.Geometry])
data_8 = Data([data_6, move_8.Geometry])
midpt_2 = CurveMiddle(Curve=partition_3)
cullpt_2 = CullDuplicates(Points=midpt_2, Tolerance=0.1, CullMode=3)  # -> Points, Indices, Valence
line_sdl = LineSDL(Start=area_5.Centroid, Direction=Vector(0, 0, 1), Length=negative)
item_5 = ListItem(List=partition_3, Index=cullpt_2.Indices, Wrap=True)

# ---- group: All Edges Connecting Egress Nodes
crv_6 = Curve(flatten([partition_2, line_sdl]))

# ---- group: Corridor Weight
length = Length(Curve=item_5)

# ----
data_9 = Data([data_8, data_7, line_sdl, partition_2])
midpt_3 = CurveMiddle(Curve=flatten(data_9))
cullpt_3 = CullDuplicates(Points=midpt_3, Tolerance=0.1, CullMode=3)  # -> Points, Indices, Valence
item_6 = ListItem(List=flatten(data_9), Index=cullpt_3.Indices, Wrap=True)  # -> flatten(Item)
list_length = ListLength(List=flatten(partition_6))
list_length_2 = ListLength(List=flatten(partition))
list_length_3 = ListLength(List=flatten(partition_4))
merge_13 = Merge(Data1=flatten(partition_6), Data2=flatten(partition), Data3=flatten(partition_4))
duplicate_data = DuplicateData(Data="EGRESS", Number=list_length_2, Order=True)
duplicate_data_2 = DuplicateData(Data="CORRIDOR", Number=list_length_3, Order=True)
duplicate_data_3 = DuplicateData(Data="UNIT", Number=list_length, Order=True)
point_list_2 = PointList(Points=merge_13)
collision_one_many = CollisionOneMany(Collider=flatten(item_6), Obstacles=graft(merge_13))  # -> Collision, Index
mass_addition = MassAddition(Input=collision_one_many.Collision)  # -> flatten(Result), PartialResults

# ---- group: Node Names / Labels
merge_14 = Merge(Data1=duplicate_data_3, Data2=duplicate_data, Data3=duplicate_data_2)

# ----
deconstruct = Deconstruct(Point=merge_13)  # -> XComponent, YComponent, ZComponent
item_index = ItemIndex(List=merge_13, Item=merge_13)
panel_9 = Panel(mass_addition.Result)

# ---- group: LIST LENGHT FOR EACH EDGE CATEGORY
merge_15 = Merge(Data1=list_length, Data2=list_length_2, Data3=list_length_3)

# ---- group: Room Nodes
point_7 = Point(flatten(partition_6))

# ---- group: Corridor Nodes
point_8 = Point(flatten(partition_4))

# ----
line_5 = Line(crv_6)

# ---- group: Egress Edge Weights
len_2 = Length(Curve=flatten(crv_6))

len_3 = Length(Curve=flatten(crv_6))

# ---- group: Corridor Weight
num = Number(flatten(length))

num_2 = Number(flatten(length))

# ----
lng_7 = ListLength(List=len_3)
lng_8 = ListLength(List=len_2)
merge_16 = Merge(Data1=simplify(graft(item_index)), Data2=simplify(graft(merge_14)), Data3=simplify(graft(mass_addition.Result)))
python_2 = GhPythonScript(
    write=toggle,
    x=deconstruct.XComponent,
    y=deconstruct.YComponent,
    z=deconstruct.ZComponent,
    path=concat_3,
    features=merge_16)  # -> out, a; inputs write: Boolean, x: list, y: list, z: list, features: tree; disabled
# ---------- python_2: Python ----------
import rhinoscriptsyntax as rs
import Rhino.Geometry as rg
import csv
import ghpythonlib.treehelpers as th

if write:
    features=th.tree_to_list(features,None)
    
    with open(path, 'wb') as file:
        writer = csv.writer(file)
        writer.writerow(['x','y','z','id','label','degree'])
        for i in range(len(x)):
           writer.writerow([x[i], y[i], z[i], features[i][0],features[i][1],features[i][2]])
        file.close
# ---------- end python_2 ----------
panel_10 = Panel(merge_16)
suirify = Suirify(deconstruct.XComponent)
suirify_2 = Suirify(deconstruct.YComponent)
suirify_3 = Suirify(deconstruct.ZComponent)
suirify_4 = Suirify(mass_addition.Result)

partition_7 = PartitionList(List=item_index, Size=merge_15)
bang_10 = ExplodeTree(Data=simplify(partition_7))  # -> Branch0, Branch1, Branch2
cp_3 = ClosestPoint(Point=point_7, Cloud=point_8)  # -> ClosestPoint, CPIndex, Distance
ln_6 = Line(StartPoint=point_7, EndPoint=cp_3.ClosestPoint)

# ---- group: Corridor Node ID
data_10 = Data(bang_10.Branch2)

# ---- group: Room Node ID
data_11 = Data(bang_10.Branch0)

# ----
item_7 = ListItem(List=data_10, Index=cp_3.CPIndex, Wrap=True)

merge_17 = Merge(Data1=flatten(ln_6), Data2=flatten(line_5), Data3=flatten(item_5))
end_4 = EndPoints(Curve=merge_17)  # -> Start, End
entwine = Entwine(Branch00=end_4.Start, Branch01=end_4.End, FlattenInputs=True)
pdecon_2 = Deconstruct(Point=merge_13)  # -> XComponent, YComponent, ZComponent
flip_2 = FlipMatrix(Data=entwine)  # -> simplify(Data)
pdecon_3 = Deconstruct(Point=flip_2)  # -> XComponent, YComponent, ZComponent
python_3 = GhPythonScript(
    vx=pdecon_3.XComponent,
    vy=pdecon_3.YComponent,
    vz=pdecon_3.ZComponent,
    x=pdecon_2.XComponent,
    y=pdecon_2.YComponent,
    z=pdecon_2.ZComponent)  # -> out, simplify(edge_verticies); inputs vx: tree, vy: tree, vz: tree, x: list, y: list, z: list
# ---------- python_3: Python ----------
import rhinoscriptsyntax as rs
#import Rhino.Geometry as rg
import ghpythonlib.treehelpers as th
#import Rhino.RhinoMath as rm

vx=th.tree_to_list(vx,None)
vy=th.tree_to_list(vy,None)
vz=th.tree_to_list(vz,None)

epsilon=0.0000000001

def epsilon_equals(value1, value2, epsilon):
    return abs(value1 - value2) < epsilon

edge_verticies=[]
for i in range(len(vx)):
    for j in range(len(x)):
        if epsilon_equals(vx[i][0],x[j],epsilon) and epsilon_equals(vy[i][0],y[j],epsilon) and epsilon_equals(vz[i][0],z[j],epsilon):
            first_node=j
        else:
            pass
        if epsilon_equals(vx[i][1],x[j],epsilon) and epsilon_equals(vy[i][1],y[j],epsilon) and epsilon_equals(vz[i][1],z[j],epsilon):
            second_node=j
        else:
            pass
    edge_verticies.append([first_node,second_node])
    
edge_verticies=th.list_to_tree(edge_verticies)
# ---------- end python_3 ----------
panel_11 = Panel(pdecon_3.XComponent)

python_4 = GhPythonScript(
    vx=pdecon_3.XComponent,
    vy=pdecon_3.YComponent,
    vz=pdecon_3.ZComponent,
    x=pdecon_2.XComponent,
    y=pdecon_2.YComponent,
    z=pdecon_2.ZComponent)  # -> out, simplify(edge_verticies); inputs vx: tree, vy: tree, vz: tree, x: list, y: list, z: list; disabled
# ---------- python_4: Python ----------
import rhinoscriptsyntax as rs
import Rhino.Geometry as rg
import ghpythonlib.treehelpers as th
import Rhino.RhinoMath as rm

vx=th.tree_to_list(vx,None)
vy=th.tree_to_list(vy,None)
vz=th.tree_to_list(vz,None)

epsilon=0.0000000001
edge_verticies=[]
for i in range(len(vx)):
    for j in range(len(x)):
        if rm.EpsilonEquals(vx[i][0],x[j],epsilon) and rm.EpsilonEquals(vy[i][0],y[j],epsilon) and rm.EpsilonEquals(vz[i][0],z[j],epsilon):
            first_node=j
        else:
            pass
        if rm.EpsilonEquals(vx[i][1],x[j],epsilon) and rm.EpsilonEquals(vy[i][1],y[j],epsilon) and rm.EpsilonEquals(vz[i][1],z[j],epsilon):
            second_node=j
        else:
            pass
    edge_verticies.append([first_node,second_node])
    
edge_verticies=th.list_to_tree(edge_verticies)
# ---------- end python_4 ----------
panel_12 = Panel(python_3.edge_verticies)

# ---- group: Room To Corridor Edge Length / Weight
len_4 = Length(Curve=ln_6)

len_5 = Length(Curve=ln_6)

# ---- group: Weights
merge_18 = Merge(Data1=flatten(len_5), Data2=flatten(len_2), Data3=flatten(num_2))  # -> simplify(graft(Result))

merge_19 = Merge(Data1=flatten(len_4), Data2=flatten(len_3), Data3=flatten(num))

# ----
lng_9 = ListLength(List=merge_19)
lng_10 = ListLength(List=merge_18)
total_weights = Panel(lng_9)
data_12 = Data(flatten(merge_18))
python_5 = GhPythonScript(write=toggle, v=python_3.edge_verticies, path=concat_4, features_1=merge_18)  # -> out, a; inputs write: Boolean, v: tree of Int32, features_1: list; disabled
# ---------- python_5: Python ----------
import rhinoscriptsyntax as rs
import Rhino.Geometry as rg
import csv
import ghpythonlib.treehelpers as th

v=th.tree_to_list(v,None)

if write:
    with open(path, 'wb') as file:
        writer = csv.writer(file)
        writer.writerow(['vi','vj','feature_1'])
        for i in range(len(v)):
           writer.writerow([v[i][0], v[i][1], features_1[i]])
        file.close
# ---------- end python_5 ----------
python_6 = GhPythonScript(write=toggle, v=python_3.edge_verticies, path=concat_4, features_1=merge_19)  # -> out, a; inputs write: Boolean, v: tree of Int32, features_1: list; disabled; same code as python_5
suirify_5 = Suirify(data_12)

# ----
# OUTPUT
python_7 = GhPythonScript(
    x=flatten(suirify),
    y=flatten(suirify_2),
    z=flatten(suirify_3),
    nodeDegree=flatten(suirify_4),
    v=python_3.edge_verticies,
    edgeFeatures=flatten(suirify_5))  # -> out, output, flatten(json_string); inputs x: list, y: list, z: list, nodeDegree: list, v: tree, edgeFeatures: list
# ---------- python_7: Python ----------
__author__ = "REN"
__version__ = "2023.08.19"

import rhinoscriptsyntax as rs
import ghpythonlib.treehelpers as th
import json

data_dict = {}
edge_dict = {}
node_dict = {}
edge_array = []
node_array = []

#if not isinstance(v, list):  # replace type_expected_for_tree with the expected type
#    print("v is not a tree!")
#else:
v = th.tree_to_list(v, None)
# edgeFeatures = th.tree_to_list(edgeFeatures, None)
c = 0

for i in range(len(v)):
    edge_dict = {
        "edge": {
            "type": "object",
            "additionalProperties": False,
            "properties": {
                "id": c,
                "source": v[i][0],
                "target": v[i][1],
                "metadata": {
                    "length": edgeFeatures[i]
                }
            }
        }
    }
    edge_array.append(edge_dict)
    c+=1

c = 0
for i in range(len(x)):
    node_dict = {
        "node": {
            "type": "object",
            "properties": {
                "label": c,
                "degree": nodeDegree[i],
                "metadata": {
                    "type": "Feature",
                    "geometry": {
                        "type": "Point",
                        "coordinates": [x[i], y[i], z[i]]
                    }
                }
            }
        }
    }
    node_array.append(node_dict)
    c+=1

data_dict = {"title": "Graph Start",
"type": "FeatureCollection",
"features": node_array + edge_array
}

output = str(data_dict)
json_string = json.dumps(data_dict)
# ---------- end python_7 ----------

data_13 = Data(python_7.json_string)
writetxt = WriteToTextFile(Run=Toggle(False), TextToWrite=data_13, FilePath=path_3, Append=False, NewOnly=False)

# ---- group: RH_OUT:output
data_14 = Data(python_7.json_string)
